# Grasshopper definition circlecleanTESTINGMOVING.gh (Grasshopper 1.0.8)
# plug-ins: RhinoCodePluginGH, Human

twist = Panel("""30
-30
30
-30
30
-30
30
-30
30
-30
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""")
twist_2 = Panel("""30
60
-60
15
15
15
-15
-15
-15
-15
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""")
panel = Panel("""0
0
-15
15
-15
15
-15
15
-15
15
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""")
lift = Panel("""30
-15
15
15
-30
15
-15
15
-15
30
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""")

crv = Curve(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)  # disabled
crv_2 = Curve(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)  # disabled
number_slider = Slider(30, range=0..45)  # disabled
edges = BrepEdges(Brep=crv_2)  # -> Naked, Interior, NonManifold; disabled
item = ListItem(List=edges.Naked, Index=0, Wrap=True)  # -> Item, Item1, Item2; disabled
rad = Radians(Degrees=number_slider)  # disabled
rotax = RotateAxis(Geometry=crv, Angle=rad, Axis=item.Item2)  # -> Geometry, Transform; disabled
rotax_2 = RotateAxis(Geometry=crv_2, Angle=rad, Axis=item.Item2)  # -> Geometry, Transform; disabled
xy = XYPlane(Origin=Point(0, 0, 0))  # disabled
pcx = CurvePlane(Curve=rotax.Geometry, Plane=xy)  # -> Points, ParamsC, ParamsP; disabled
debrep = DeconstructBrep(Brep=rotax_2.Geometry)  # -> Faces, Edges, Vertices; disabled
item_2 = ListItem(List=pcx.Points, Index=0, Wrap=True)  # disabled
item_3 = ListItem(List=debrep.Vertices, Index=0, Wrap=True)  # -> Item, Item1; disabled
item_4 = ListItem(List=debrep.Edges, Index=0, Wrap=True)  # disabled
ln = Line(StartPoint=item_3.Item1, EndPoint=item_2)  # disabled
ln_2 = Line(StartPoint=item_3.Item, EndPoint=item_2)  # disabled
crv_cp = CurveClosestPoint(Point=item_2, Curve=item_4)  # -> Point, Parameter, Distance; disabled
vec2pt = Vector2Pt(PointA=crv_cp.Point, PointB=item_2, Unitize=False)  # -> Vector, Length; disabled
devec = DeconstructVector(Vector=vec2pt.Vector)  # -> XComponent, YComponent, ZComponent; disabled
vec = VectorXYZ(XComponent=devec.XComponent, YComponent=devec.YComponent, ZComponent=0)  # -> Vector, Length; disabled
angle = Angle(VectorA=vec2pt.Vector, VectorB=vec.Vector)  # -> Angle, Reflex; disabled
deg = Degrees(Radians=angle.Angle)  # disabled

random = Random(Range=Domain(0, 35), Number="20", Seed=2)
int = Integer(random)
replace = ReplaceItems(List=twist, Item="0", Indices=int, Wrap=False)
data = Data()
reduce = RandomReduce(List=twist, Reduction="20", Seed=1)
shake = Panel("""30
-30
30
-30
30
-30
30
45
-30
0
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""")
makejson = MakeJson(data=replace)
duplist = Duplist(data=data)
panel_2 = Panel(makejson)
makeindices = MakeIndices(A=data)

# ---- group: COLLAPSE
collapsesolver = CollapseSolver(D="45")
customweave = CustomWeave(D="45", D_2=collapsesolver)
makefulllist = Duplist(data=customweave)

# ----
int_2 = Integer(makeindices)
data_2 = Data(data)

swing = IronPython2Script(
    swingValMin=Slider(6, range=0..35),
    swingValMax=Slider(30, range=0..35),
    swing_len=Slider(8, range=0..15),
    swing_start=Slider(25, range=0..35))  # -> out, out_2; inputs swing_len: Int32, swing_start: Int32
# ---------- swing: IronPython ----------
out = []
mydict = {}

for i in range(swing_len+1):
    mydict[(swing_start+i)%36] = (((i - 0) * (swingValMax - swingValMin)) / (swing_len - 0)) + swingValMin


for i in range(35):
    if i in mydict.keys():
        if i % 2:
            out.append(mydict[i])
        else:
            out.append(-mydict[i])
    else:
        out.append(0)
# ---------- end swing ----------

data_3 = Data(int_2)
data_4 = Data(data_2)

ipy2 = IronPython2Script(toggles=data_3, angles=data_4)  # -> out, output; inputs toggles: list, angles: list of Int32
# ---------- ipy2: IronPython ----------
import json

angleObjects = []
for index in range(len(toggles)):
    angleObjects.append({"toggle":toggles[index], "angle": angles[index]})
    print(angleObjects)

output = json.dumps( {"type":"angles", "angles":angleObjects})
# ---------- end ipy2 ----------
ipy2_2 = IronPython2Script(inJson=ipy2.output)  # -> out, t, a; inputs inJson: String
# ---------- ipy2_2: IronPython ----------
import json

data = json.loads(inJson)

tBuffer = []
aBuffer = []

for d in data["angles"]:
    tBuffer.append(d["toggle"])
    aBuffer.append(d["angle"])

t = tBuffer
a = aBuffer
# ---------- end ipy2_2 ----------
data_5 = Data(ipy2_2.t)
data_6 = Data(ipy2_2.a)

cluster = Cluster_2(toggle=data_5, angle=data_6)  # -> mesh_4, mesh_3, angle_2, angle_00, V
data_7 = Data(cluster.mesh_3)
data_8 = Data(cluster.angle_2)
data_9 = Data(cluster.angle_00)
data_10 = Data(cluster.V)
medges = MeshEdges(Mesh=data_7)  # -> NakedEdges, InteriorEdges, NonManifoldEdges
line = Line(medges.InteriorEdges)
remapper = ListItem(List=line, Index=[0, 2, 3, 4, 5, 6, 7, 8, 9, 10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], Wrap=True)
crv_3 = Curve(remapper)
cull = CullPattern(List=crv_3, CullPattern=invert(data_3))
cull_2 = CullPattern(List=crv_3, CullPattern=data_3)
cluster_2 = Cluster_3(line=remapper)
previewlw = CustomPreviewLineweights(Geometry=cull_2, Shader=ColourSwatch(SwatchColor=RGB(0, 0, 0)), Thickness="2", Absolute=False)
previewlw_2 = CustomPreviewLineweights(Geometry=cull, Shader=ColourSwatch(SwatchColor=RGB(0, 214, 11)), Thickness="2", Absolute=False)

# ==== cluster Cluster_2
_10º = PowerOf10(Value=Slider(5, range=1..9))
circlemaker = CircleMaker(A="36", B="36", R="975", A_2="1250")  # -> L, S, P

pt = Point(circlemaker.L)
crv = Curve(circlemaker.S)
pt_2 = Point(circlemaker.P)

meshmaker = MeshMaker(_0=pt, _1=pt_2, int="36")
mesh = Mesh(meshmaker)
toggle = ClusterInput()
angle = ClusterInput()
cluster = Cluster(data=toggle, data_2=angle, mesh=mesh, int="36", int_2=_10º)  # -> mesh_3, data_6
solver = Solver(goalobjects=cluster.data_6)

# ---- group: RH:OUTMESH
mesh_2 = Mesh(solver)

# ----
mesh_3 = ClusterOutput(mesh_2)
mesh_4 = ClusterOutput(mesh)
angle_calculator = Angle_calculator(int="36", mesh=mesh_2)  # -> angle_3, angle_00_2
demesh = DeconstructMesh(Mesh=mesh_2)  # -> Vertices, Faces, Colours, Normals
V = ClusterOutput(demesh.Vertices)
angle_2 = ClusterOutput(angle_calculator.angle_3)
angle_00 = ClusterOutput(angle_calculator.angle_00_2)

# ==== cluster Cluster_3
line = ClusterInput()
line_2 = Line(line)
midpt = CurveMiddle(Curve=line_2)
lng = ListLength(List=midpt)
series = Series(Start=0, Step=1, Count=lng)
xz = XZPlane(Origin=midpt)
tag = TextTag(Location=xz, Text=series, Colour=ColourSwatch(SwatchColor=RGB(0, 157, 255)))

# ==== cluster CollapseSolver
crv = Curve(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)
crv_2 = Curve(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)
D = ClusterInput()
edges = BrepEdges(Brep=crv)  # -> Naked, Interior, NonManifold
rad = Radians(Degrees=D)
item = ListItem(List=edges.Naked, Index=0, Wrap=True)  # -> Item, Item1, Item2
neg = Negative(Value=rad)
rotax = RotateAxis(Geometry=crv, Angle=neg, Axis=item.Item)  # -> Geometry, Transform
rotax_2 = RotateAxis(Geometry=crv_2, Angle=neg, Axis=item.Item)  # -> Geometry, Transform
xy = XYPlane(Origin=Point(0, 0, 0))
pcx = CurvePlane(Curve=rotax_2.Geometry, Plane=xy)  # -> Points, ParamsC, ParamsP
debrep = DeconstructBrep(Brep=rotax.Geometry)  # -> Faces, Edges, Vertices
item_2 = ListItem(List=pcx.Points, Index=0, Wrap=True)
item_3 = ListItem(List=debrep.Edges, Index=0, Wrap=True)  # -> Item, Item1
crv_cp = CurveClosestPoint(Point=item_2, Curve=item_3.Item1)  # -> Point, Parameter, Distance
vec2pt = Vector2Pt(PointA=crv_cp.Point, PointB=item_2, Unitize=False)  # -> Vector, Length
devec = DeconstructVector(Vector=vec2pt.Vector)  # -> XComponent, YComponent, ZComponent
vec = VectorXYZ(XComponent=devec.XComponent, YComponent=devec.YComponent, ZComponent=0)  # -> Vector, Length
angle = Angle(VectorA=vec2pt.Vector, VectorB=vec.Vector)  # -> Angle, Reflex
deg = Degrees(Radians=angle.Angle)
D_2 = ClusterOutput(deg)

# ==== cluster CustomWeave
pick_n_choose_mask = Panel("""1
0
1
1
0
1
1
0
1
1
0
1
1
0
1
1""")
D = ClusterInput()
D_2 = ClusterInput()
lng = ListLength(List=pick_n_choose_mask)
polarity_mask = Panel("""1
1.5
1
-1
-1
-1
1
1
1
-1
-1
-1
1
1
1
-1""")
dup = DuplicateData(Data=D, Number=lng, Order=True)
dup_2 = DuplicateData(Data=D_2, Number=lng, Order=True)
p_n_c = PickNChoose(Pattern=pick_n_choose_mask, Stream0=dup, Stream1=dup_2)
multiplication = Multiplication(A=polarity_mask, B=p_n_c)
R = ClusterOutput(multiplication)

# ==== cluster Duplist
data = ClusterInput()
data_2 = Data(data)
lng = ListLength(List=data_2)
series = Series(Start="35", Step=-1, Count=lng)
series_2 = Series(Start=0, Step=1, Count=lng)
replace = ReplaceItems(
    List=["0", "0", "0", "0", "0", "0", "0", "0", "0", "0", "0", "0", "0", "0", "0", "0", "0", "0", "0", "0", "0", "0", "0", "0", "0", "0", "0", "0", "0", "0", "0", "0", "0", "0", "0", "0"],
    Item=data_2,
    Indices=series_2,
    Wrap=False)
neg = Negative(Value=data_2)
replace_2 = ReplaceItems(List=replace, Item=neg, Indices=series, Wrap=False)
L = ClusterOutput(replace_2)

# ==== cluster MakeIndices
A = ClusterInput()
equals = Equality(FirstNumber=A, SecondNumber="0")  # -> Equality, Inequality
invbool = InvertBoolean(Boolean=equals.Equality)  # -> Inverted, Number
int = Integer(invbool.Inverted)
int_2 = ClusterOutput(int)

# ==== cluster MakeJson
data = ClusterInput()
data_2 = Data(data)
makeindices = MakeIndices(A=data_2)
ipy2 = IronPython2Script(toggles=makeindices, angles=data_2)  # -> out, output; inputs toggles: list, angles: list of Int32
# ---------- ipy2: IronPython ----------
import json

angleObjects = []
for index in range(len(toggles)):
    angleObjects.append({"t":toggles[index], "a": angles[index]})
    print(angleObjects)

output = json.dumps( {"type":"angles", "angles":angleObjects})
# ---------- end ipy2 ----------
output = ClusterOutput(ipy2.output)

# ==== cluster CircleMaker
pt = ConstructPoint(XCoordinate=0, YCoordinate=0, ZCoordinate=0)
xz = XZPlane(Origin=pt)
A = ClusterInput()
pflip = FlipPlane(Plane=xz, ReverseX=False, ReverseY=False, SwapAxes=True)
division = Division(A=A, B=2)
B = ClusterInput()
division_2 = Division(A="360", B=B)
rad = Radians(Degrees=division_2)
cos = Cosine(Value=rad)
A_2 = ClusterInput()
prot = RotatePlane(Plane=pflip, Angle=degrees(division_2))
R = ClusterInput()
division_3 = Division(A=A_2, B=cos)
cir = Circle(Plane=pflip, Radius=R)
cir_2 = Circle(Plane=prot, Radius=division_3)
divide = DivideCurve(Curve=cir, Count=division, Kinks=False)  # -> Points, Tangents, Parameters
shift = ShiftList(List=divide.Points, Shift=1, Wrap=True)
divide_2 = DivideCurve(Curve=cir_2, Count=division, Kinks=False)  # -> Points, Tangents, Parameters
L = ClusterOutput(shift)
P = ClusterOutput(divide_2.Points)
weave = Weave(Pattern=[0, 1], Stream0=divide_2.Points, Stream1=shift, NullGaps=False)
pline = PolyLine(Vertices=weave, Closed=True)
explode = Explode(Curve=pline, Recursive=True)  # -> Segments, Vertices
S = ClusterOutput(explode.Segments)

# ==== cluster MeshMaker
int = ClusterInput()
int_2 = Integer(int)
_0 = ClusterInput()
_1 = ClusterInput()
series = Series(Start=0, Step=1, Count=int_2)
weave = Weave(Pattern=[1, 0], Stream0=_0, Stream1=_1, NullGaps=False)
shift = ShiftList(List=weave, Shift=-1, Wrap=True)
addition = Addition(A=series, B=2)
addition_2 = Addition(A=series, B=1)
mod = Modulus(A=addition, B=int_2)
mod_2 = Modulus(A=addition_2, B=int_2)
mod_3 = Modulus(A=series, B=int_2)
concat = Concatenate(FragmentA="Q{", FragmentB=mod_3, FragmentC=";", FragmentD=mod_2, FragmentE=";", FragmentF=mod, FragmentG="}")
conmesh = ConstructMesh(Vertices=shift, Faces=concat)
unim = UnifyMesh(Mesh=conmesh)  # -> Result, Count
R = ClusterOutput(unim.Result)

# ==== cluster Cluster
int = ClusterInput()
int_2 = ClusterInput()
data = ClusterInput()
mesh = ClusterInput()
int_3 = Integer(int)
data_2 = ClusterInput()
int_4 = Integer(int_2)
data_3 = Data(data)
mesh_2 = Mesh(mesh)
data_4 = Data(data_2)
mesh_3 = ClusterOutput(mesh_2)
series = Series(Start=0, Step=1, Count=int_3)
addition = Addition(A=series, B=1)

demesh = DeconstructMesh(Mesh=mesh_2)  # -> Vertices, Faces, Colours, Normals
item = ListItem(List=demesh.Vertices, Index=0, Wrap=True)  # -> Item2, Item1, Item, Item1_2
anchor = Anchor(Point=[item.Item1, item.Item1_2], Strength=int_4)

demesh_2 = DeconstructMesh(Mesh=mesh_2)  # -> Vertices, Faces, Colours, Normals
mod = Modulus(A=addition, B=int_3)
mod_2 = Modulus(A=series, B=int_3)
shift = ShiftList(List=mod_2, Shift=-1, Wrap=True)
shift_2 = ShiftList(List=mod_2, Shift=2, Wrap=True)
equals = Equality(FirstNumber=data_3, SecondNumber=0)  # -> Equality, Inequality
edgelengths = EdgeLengths(Mesh=mesh_2, LengthFactor=1, Strength=int_4)
item_2 = ListItem(List=demesh_2.Vertices, Index=mod_2, Wrap=True)
show = Show(G=mesh_2)
item_3 = ListItem(List=demesh_2.Vertices, Index=mod, Wrap=True)
item_4 = ListItem(List=demesh_2.Vertices, Index=shift, Wrap=True)
item_5 = ListItem(List=demesh_2.Vertices, Index=shift_2, Wrap=True)
cull = CullPattern(List=data_4, CullPattern=equals.Inequality)
cull_2 = CullPattern(List=series, CullPattern=data_3)
rad = Radians(Degrees=cull)
nofoldthrough = NoFoldThrough(FoldStart=item_2, FoldEnd=item_3, Tip1=item_4, Tip2=item_5, Strength=int_4)
item_6 = ListItem(List=item_2, Index=cull_2, Wrap=True)
item_7 = ListItem(List=item_3, Index=cull_2, Wrap=True)
item_8 = ListItem(List=item_4, Index=cull_2, Wrap=True)
item_9 = ListItem(List=item_5, Index=cull_2, Wrap=True)
hinge = Hinge(FoldStart=item_6, FoldEnd=item_7, Tip1=item_8, Tip2=item_9, RestAngle=rad, Strength=int_4)
data_5 = Data(flatten([show, anchor, edgelengths, nofoldthrough, hinge]))
data_6 = ClusterOutput(data_5)

# ==== cluster Angle_calculator
int = ClusterInput()
mesh = ClusterInput()
int_2 = Integer(int)
mesh_2 = Mesh(mesh)
series = Series(Start=0, Step=1, Count=int_2)
addition = Addition(A=series, B=1)
facen = FaceNormals(Mesh=mesh_2)  # -> Centers, Normals
mod = Modulus(A=addition, B=int_2)
mod_2 = Modulus(A=series, B=int_2)
item = ListItem(List=facen.Normals, Index=mod_2, Wrap=True)
item_2 = ListItem(List=facen.Normals, Index=mod, Wrap=True)
item_3 = ListItem(List=facen.Centers, Index=mod, Wrap=True)
item_4 = ListItem(List=facen.Centers, Index=mod_2, Wrap=True)
amp = Amplitude(Vector=item, Amplitude="100")
amp_2 = Amplitude(Vector=item_2, Amplitude="100")
addition_2 = Addition(A=item_4, B=amp)
addition_3 = Addition(A=item_3, B=amp_2)
angle = Angle(VectorA=item, VectorB=item_2)  # -> Angle, Reflex
vec2pt = Vector2Pt(PointA=item_4, PointB=item_3, Unitize=False)  # -> Vector, Length
vec2pt_2 = Vector2Pt(PointA=addition_2, PointB=addition_3, Unitize=False)  # -> Vector, Length
larger = LargerThan(FirstNumber=vec2pt.Length, SecondNumber=vec2pt_2.Length)  # -> LargerThan, OrEqualTo
sift = SiftPattern(List=angle.Angle, SiftPattern=larger.LargerThan)  # -> Output0, Output1
neg = Negative(Value=sift.Output1)
combine = CombineData(Input0=sift.Output0, Input1=neg)  # -> Result, Index
deg = Degrees(Radians=combine.Result)
shift = ShiftList(List=deg, Shift=-1, Wrap=True)
multiplication = Multiplication(A=shift, B="100")
int_3 = Integer(multiplication)
division = Division(A=int_3, B="100")
angle_2 = Data(shift)
angle_00 = Data(division)
angle_3 = ClusterOutput(angle_2)
angle_00_2 = ClusterOutput(angle_00)

# ==== cluster Solver
goalobjects = ClusterInput()
zombiesolver = ZombieSolver(GoalObjects=goalobjects, Threshold=1e-10, Tolerance=0.0001, MaxIterations=50000)  # -> I, V, O
item = ListItem(List=zombiesolver.O, Index=0, Wrap=True)
mesh = Mesh(item)
mesh_2 = ClusterOutput(mesh)
