# Grasshopper definition socket.gh (Grasshopper 1.0.8)
# plug-ins: jSwan, RhinoCodePluginGH, ghWebSocket Info

trigger = Trigger(Interval=1000, TimerInterval=1000, Target=websocket_client)
websocket_client = WebSocketClient(Host="localhost", Port="8001", Interval="1000")  # -> Socket, Message
websocket_receive = WebSocketReceive(Socket=websocket_client.Socket)
panel = Panel(websocket_receive)
websocket_state = WebSocketState(Socket=websocket_client.Socket)
ipy2 = IronPython2Script(data=websocket_receive)  # -> out, a; inputs data: String
# ---------- ipy2: IronPython ----------
import json

a = json.loads(data)["angles"]
# ---------- end ipy2 ----------
panel_2 = Panel(ipy2.a)
panel_3 = Panel(websocket_state)
ipy2_2 = IronPython2Script(x=websocket_state)  # -> out, a
# ---------- ipy2_2: IronPython ----------
if x == "Open":
    a = 0
else:
    a = 1
# ---------- end ipy2_2 ----------
rejson = SerializeJson(Type="login", Client="interface", IncludeNullAndEmptyProperties=False)
rejson_2 = SerializeJson(Type="login", Client="gh", IncludeNullAndEmptyProperties=False)
websocket_send = WebSocketSend(Socket=websocket_client.Socket, Broadcast=False, ForceSend=False)
panel_5 = Panel(rejson)
websocket_send_2 = WebSocketSend(Socket=websocket_client.Socket, Message=rejson_2, Broadcast=ipy2_2.a, ForceSend=False)
